# Grasshopper definition 01_HelloWorld.gh (Grasshopper 0.9.76)
# plug-ins: Machina

# ---- group: Create a simple Action
# A simple "Hello World" program ;)
panel = Panel("Hello World!")
message = Message(Message=panel)

# ---- group: Generate native code / Compile the program into native code
createrobot = CreateRobot(Name="MyFirstRobot", Brand="ABB")
compileprogram = CompileProgram(Robot=createrobot, Actions=message, InLineTargets=Toggle(True), Comments=Toggle(True))

# ---- group: Stream code to file: right-click on panel and stream contents to a text file in your system
panel_2 = Panel(compileprogram)
