# Grasshopper definition 03_SimpleProgram_VerticalSquare.gh (Grasshopper 0.9.76)
# plug-ins: Machina

# ---- group: Transform to base plane (inverted to match robot's TCP orientation)
# A program where the robot traces a vertical square.
number_slider = Slider(400, range=0..1000)
construct_point = ConstructPoint(XCoordinate=number_slider, YCoordinate=Slider(200, range=0..1000), ZCoordinate=Slider(500, range=0..1000))
xy_plane = XYPlane(Origin=construct_point)
deconstruct_plane = DeconstructPlane(Plane=xy_plane)  # -> Origin, XAxis, YAxis, ZAxis
rotate_3d = Rotate3D(Geometry=xy_plane, Angle=degrees("180"), Center=deconstruct_plane.Origin, Axis=deconstruct_plane.YAxis)  # -> Geometry, Transform
transformto = TransformTo(Plane=rotate_3d.Geometry, Relative=False)

# ---- group: Trace a vertical square of side # mm using relative movements
number_slider_2 = Slider(75, range=0..100)
negative = Negative(Value=number_slider_2)
unit_y = UnitY(Factor=number_slider_2)
unit_z = UnitZ(Factor=number_slider_2)
unit_y_2 = UnitY(Factor=negative)
unit_z_2 = UnitZ(Factor=negative)

# ---- group: Draw the square slower, more precise and using linear movements
precisionto = PrecisionTo(Radius=Slider(5, range=0..10), Relative=False)
speedto = SpeedTo(Speed=Slider(50, range=0..500), Relative=False)
motionmode = MotionMode(MotionMode=0)

# ---- group: Wait before going back home
wait = Wait(Time=Slider(1000, range=0..1000))

# ---- group: Speed things up again
precisionto_2 = PrecisionTo(Radius=Slider(5, range=0..10), Relative=False)
speedto_2 = SpeedTo(Speed=Slider(100, range=0..500), Relative=False)

# ---- group: Set initial Speed
speedto_3 = SpeedTo(Speed=Slider(100, range=0..500), Relative=False)

# ---- group: Set initial target Precision
precisionto_3 = PrecisionTo(Radius=Slider(5, range=0..10), Relative=False)

# ---- group: Rotate tobot flange around the Y Axis
unit_y_3 = UnitY(Factor=1)
rotate = Rotate(Axis=unit_y_3, Angle=Slider(-90, range=-100..100), Relative=True)

# ---- group: Wait before drawing the square
wait_2 = Wait(Time=Slider(1000, range=0..1000))

# ---- group: Go back to a 'home' position using joint rotation values directly
axesto = AxesTo(A1="0", A2="0", A3="0", A4="0", A5="90", A6="0", Relative=False)

# ----
move = Move(Vector=unit_y, Relative=True)
move_2 = Move(Vector=unit_z, Relative=True)
move_3 = Move(Vector=unit_y_2, Relative=True)
move_4 = Move(Vector=unit_z_2, Relative=True)

# ---- group: Change to "joint" motion type
motionmode_2 = MotionMode(MotionMode=1)

# ---- group: First part of the program: approaching the target and getting ready to 'draw'
merge = Merge(Data1=speedto_3, Data2=precisionto_3, Data3=motionmode_2, Data4=transformto, Data5=rotate, Data6=wait_2)

# ---- group: Second part of the program: 'trace' a vertical square with relative motions.
merge_2 = Merge(Data1=speedto, Data2=precisionto, Data3=motionmode, Data4=move, Data5=move_2, Data6=move_3, Data7=move_4, Data8=wait)

# ---- group: Third part: go back 'home' setting joint rotation values.
merge_3 = Merge(Data1=speedto_2, Data2=precisionto_2, Data3=axesto)

# ---- group: Combine program parts and flatten all the actions into a single Program
merge_4 = Merge(Data1=merge, Data2=merge_2, Data3=merge_3)
panel = Panel(merge_4)

# ---- group: Stream in real-time to Machina Bridge
sendtobridge = SendToBridge(Actions=merge_4, BridgeURL="ws://127.0.0.1:6999/Bridge", Send=Button())  # -> Sent, Instructions
panel_2 = Panel(sendtobridge.Sent)
panel_3 = Panel(sendtobridge.Instructions)

# ---- group: Generate native code / Compile the program into native code
createrobot = CreateRobot(Name="squareTracer", Brand="ABB")
compileprogram = CompileProgram(Robot=createrobot, Actions=merge_4, InLineTargets=Toggle(True), Comments=Toggle(False))

# ---- group: Stream code to file: right-click on panel and stream contents to a text file in your system
panel_4 = Panel(compileprogram)
