# Grasshopper definition 07_3DPrinting.gh (Grasshopper 0.9.76)
# plug-ins: Machina

waypoints_per_layer = Slider(64, range=0..1000)
# A program where the robot 3D prints a surface
surface = Surface(<surface referenced from the Rhino model>)
layer_height = Slider(3, range=0..10)

robot_name = Panel("PrinterArm")
robot_brand = Panel("ABB")

tool_weigth_kg = Slider(5, range=0..10)
tool_io_pin = Slider(1, range=0..10)
tool_name = Panel("ExtruderTool")
tool_io_name = Panel("ExtruderIO")
tool_center_point = Point(<point referenced from the Rhino model>)
digital_io = BooleanToggle(True)
base_point = Point(<point referenced from the Rhino model>)

travel_speed = Slider(200, range=0..200)
travel_precision = Slider(10, range=0..10)
print_speed = Slider(100, range=0..100)
print_precision = Slider(10, range=0..10)

# ---- group: Discretize the geometry into toolpaths and target Planes for 3D printing
bounding_box = BoundingBox(Content=surface, Plane=PlaneXY(0, 0, 0))  # -> Box, Box_2
box_properties = BoxProperties(Box=bounding_box.Box)  # -> Center, Diagonal, Area, Volume, Degeneracy
deconstruct_vector = DeconstructVector(Vector=box_properties.Diagonal)  # -> XComponent, YComponent, ZComponent
expression = Expression(x=deconstruct_vector.ZComponent, Expression="x/2")
negative = Negative(Value=expression)
unit_z = UnitZ(Factor=negative)
expression_2 = Expression(x=deconstruct_vector.ZComponent, y=layer_height, Expression="ceiling(x / y)")
move = Move(Geometry=box_properties.Center, Motion=unit_z)  # -> Geometry, Transform
series = Series(Start=0, Step=layer_height, Count=expression_2)
xy_plane = XYPlane(Origin=move.Geometry)
unit_z_2 = UnitZ(Factor=series)
move_2 = Move(Geometry=xy_plane, Motion=unit_z_2)  # -> Geometry, Transform
brep_plane = BrepPlane(Brep=surface, Plane=move_2.Geometry)  # -> Curves, Points
divide_curve = DivideCurve(Curve=brep_plane.Curves, Count=waypoints_per_layer, Kinks=False)  # -> Points, Tangents, Parameters
xy_plane_2 = XYPlane(Origin=divide_curve.Points)
plane = Plane(xy_plane_2)

# ---- group: Tool Center Plane: note the plane reorientation to match the orientation of the target Planes
unit_z_3 = UnitZ(Factor=1)
unit_y = UnitY(Factor=1)
construct_plane = ConstructPlane(Origin=tool_center_point, XAxis=unit_z_3, YAxis=unit_y)

# ---- group: Tool Base Plane
xy_plane_3 = XYPlane(Origin=base_point)

# ---- group: Robot creation
createrobot = CreateRobot(Name=robot_name, Brand=robot_brand)

# ---- group: Configure the IO name
setioname = SetIOName(Robot=createrobot, Name=tool_io_name, Pin=tool_io_pin, Digital=digital_io)

# ---- group: Tool creation
createtool = CreateTool(Name=tool_name, BasePlane=xy_plane_3, TCPPlane=construct_plane, Weight=tool_weigth_kg)

# ----
flatten_tree = FlattenTree(Tree=plane, Path="{0}")
list_item = ListItem(List=flatten_tree, Index=0, Wrap=True)

# ---- group: Turn extruder Tool on
writedigital = WriteDigital(DigitalPinNumber=tool_io_pin, On=Toggle(True))

# ---- group: Turn extruder Tool off
writedigital_2 = WriteDigital(DigitalPinNumber=tool_io_pin, On=Toggle(False))

# ---- group: Speed up and go to the first target
precisionto = PrecisionTo(Radius=travel_precision, Relative=False)
speedto = SpeedTo(Speed=travel_speed, Relative=False)
transformto = TransformTo(Plane=list_item, Relative=False)

# ---- group: Slow down and go over all target Planes
precisionto_2 = PrecisionTo(Radius=print_precision, Relative=False)
speedto_2 = SpeedTo(Speed=print_speed, Relative=False)
transformto_2 = TransformTo(Plane=flatten_tree, Relative=False)

# ---- group: Speed up and go back home
precisionto_3 = PrecisionTo(Radius=travel_precision, Relative=False)
speedto_3 = SpeedTo(Speed=travel_speed, Relative=False)
axesto = AxesTo(A1="0", A2="0", A3="0", A4="0", A5="90", A6="0", Relative=False)

# ---- group: Attach the Tool at the beginning of the program
attach = Attach(Tool=createtool)

# ---- group: Combine actions and merge them into a program
merge = Merge(
    Data1=attach,
    Data2=speedto,
    Data3=precisionto,
    Data4=transformto,
    Data5=writedigital,
    Data6=speedto_2,
    Data7=precisionto_2,
    Data8=transformto_2,
    Data9=writedigital_2,
    Data10=speedto_3,
    Data11=precisionto_3,
    Data12=axesto)
panel = Panel(merge)

# ---- group: Generate native code
compileprogram = CompileProgram(Robot=setioname, Actions=merge, InLineTargets=Toggle(True), Comments=Toggle(False))

# ---- group: Stream code to file: right-click on panel and stream contents to a text file in your system
# (Panels with a lot of text slow GH down; deactivate this panel if the definition becomes too laggy)
panel_2 = Panel(compileprogram)
