# Grasshopper definition 02_SimpleProgram_VerticalLine.gh (Grasshopper 0.9.76)
# plug-ins: Machina

# ---- group: Transform to base plane (inverted to match robot's TCP orientation)
# A simple program that traces a vertical line in space
number_slider = Slider(400, range=0..1000)
construct_point = ConstructPoint(XCoordinate=number_slider, YCoordinate=Slider(200, range=0..1000), ZCoordinate=Slider(500, range=0..1000))
xy_plane = XYPlane(Origin=construct_point)
deconstruct_plane = DeconstructPlane(Plane=xy_plane)  # -> Origin, XAxis, YAxis, ZAxis
rotate_3d = Rotate3D(Geometry=xy_plane, Angle=degrees("180"), Center=deconstruct_plane.Origin, Axis=deconstruct_plane.YAxis)  # -> Geometry, Transform
transformto = TransformTo(Plane=rotate_3d.Geometry, Relative=False)

# ---- group: Move along vector relative to where Robot is right now
unit_z = UnitZ(Factor=Slider(250, range=0..1000))
move = Move(Vector=unit_z, Relative=True)

# ---- group: Set initial Speed
speedto = SpeedTo(Speed=Slider(100, range=0..100), Relative=False)

# ---- group: Rotate tobot flange around the Y Axis
unit_y = UnitY(Factor=1)
rotate = Rotate(Axis=unit_y, Angle=Slider(-90, range=-100..100), Relative=True)

# ---- group: Slow down
speedto_2 = SpeedTo(Speed=Slider(50, range=-100..100), Relative=False)

# ---- group: Wait a bit before continuing
wait = Wait(Time=Slider(2500, range=0..5000))

# ---- group: Fast again
speedto_3 = SpeedTo(Speed=Slider(100, range=0..100), Relative=False)

# ---- group: Start message ;)
message = Message(Message="Let's do some robots!")

# ---- group: Go back to a 'home' position using joint rotation values directly
axesto = AxesTo(A1="0", A2="0", A3="0", A4="0", A5="90", A6="0", Relative=False)

# ---- group: Merge actions into a list and display them
merge = Merge(
    Data1=message,
    Data2=speedto,
    Data3=transformto,
    Data4=rotate,
    Data5=speedto_2,
    Data6=move,
    Data7=wait,
    Data8=speedto_3,
    Data9=axesto)
panel = Panel(merge)

# ---- group: Generate native code / Compile the program into native code
createrobot = CreateRobot(Name="MachinaRobot", Brand="ABB")
compileprogram = CompileProgram(Robot=createrobot, Actions=merge, InLineTargets=Toggle(True), Comments=Toggle(True))

# ---- group: Stream code to file: right-click on panel and stream contents to a text file in your system
panel_2 = Panel(compileprogram)
