# Grasshopper definition 01_HelloWorld.gh (Grasshopper 1.0.7)
# plug-ins: Machina

# ---- group: Create a simple Action
# A simple "Hello World" program ;)
panel = Panel("Hello World!")
message = Message(Message=panel)

# ---- group: Create a new Robot
createrobot = CreateRobot(Name="MyFirstRobot", Brand="ABB")

# ---- group: Generate native Robot Program from a list of Actions
compileprogram = CompileProgram(Robot=createrobot, Actions=message, InLineTargets=Toggle(True), Comments=Toggle(True))

# ---- group: Visualize the Program in native code
displayprogram = DisplayProgram(RobotProgram=compileprogram)
panel_2 = Panel(displayprogram)

# ---- group: Save the Robot Program to this definition's folder
c_script = CSharpScript()  # -> out, here
# ---------- c_script: C# usings ----------
using System.IO;
# ---------- c_script: C# ----------
    string targetFolder = "";

    GH_Document gh_d = owner.OnPingDocument();
    if (gh_d.IsFilePathDefined)
    {
      string ghFilePath = gh_d.FilePath;
      targetFolder = Path.GetDirectoryName(ghFilePath);
    }
    else
    {
      Print("No local folder found, please save your file locally.");
    }

    here = targetFolder;
# ---------- end c_script ----------
saveprogram = SaveProgram(Robot=createrobot, RobotProgram=compileprogram, Path=c_script.here)
panel_3 = Panel(saveprogram)
