# Grasshopper definition 03_SimpleProgram_VerticalSquare.gh (Grasshopper 1.0.7)
# plug-ins: Machina

# ---- group: Transform to base plane (inverted to match robot's TCP orientation)
# A program where the robot traces a vertical square.
number_slider = Slider(200, range=0..1000)
construct_point = ConstructPoint(XCoordinate=number_slider, YCoordinate=Slider(400, range=0..1000), ZCoordinate=Slider(300, range=0..1000))
xy_plane = XYPlane(Origin=construct_point)
deconstruct_plane = DeconstructPlane(Plane=xy_plane)  # -> Origin, XAxis, YAxis, ZAxis
rotate_3d = Rotate3D(Geometry=xy_plane, Angle=degrees("180"), Center=deconstruct_plane.Origin, Axis=deconstruct_plane.YAxis)  # -> Geometry, Transform
transformto = TransformTo(Plane=rotate_3d.Geometry, Relative=False)

# ---- group: Trace a vertical square of side # mm using relative movements
number_slider_2 = Slider(50, range=0..100)
negative = Negative(Value=number_slider_2)
unit_y = UnitY(Factor=number_slider_2)
unit_z = UnitZ(Factor=number_slider_2)
unit_y_2 = UnitY(Factor=negative)
unit_z_2 = UnitZ(Factor=negative)

# ---- group: Draw the square slower, more precise and using linear movements
precisionto = PrecisionTo(Radius=Slider(1, range=0..10), Relative=False)
speedto = SpeedTo(Speed=Slider(50, range=0..500), Relative=False)
motionmode = MotionMode(MotionMode=0)

# ---- group: Wait before going back home
wait = Wait(Time=Slider(2000, range=0..5000))

# ---- group: Speed things up again
speedto_2 = SpeedTo(Speed=Slider(150, range=0..500), Relative=False)

# ---- group: Set initial Speed
speedto_3 = SpeedTo(Speed=Slider(150, range=0..500), Relative=False)

# ---- group: Set initial target Precision
precisionto_2 = PrecisionTo(Radius=Slider(5, range=0..10), Relative=False)

# ---- group: Rotate tobot flange around the Y Axis
unit_y_3 = UnitY(Factor=1)
rotate = Rotate(Axis=unit_y_3, Angle=Slider(-90, range=-100..100), Relative=True)

# ---- group: Starting message
message = Message(Message="Drawing 50x50 square")

# ---- group: Farewell message
message_2 = Message(Message="Done, going back home")

# ---- group: Move to starting position at "home"
axesto = AxesTo(A1="0", A2="0", A3="0", A4="0", A5="90", A6="0", Relative=False)

# ---- group: Go back to a 'home' position using joint rotation values directly
axesto_2 = AxesTo(A1="0", A2="0", A3="0", A4="0", A5="90", A6="0", Relative=False)

# ----
move = Move(Vector=unit_y, Relative=True)
move_2 = Move(Vector=unit_z, Relative=True)
move_3 = Move(Vector=unit_y_2, Relative=True)
move_4 = Move(Vector=unit_z_2, Relative=True)

# ---- group: Change to "joint" motion type
motionmode_2 = MotionMode(MotionMode=1)

# ---- group: First part of the program: approaching the target and getting ready to 'draw'
merge = Merge(Data1=speedto_3, Data2=precisionto_2, Data3=axesto, Data4=message, Data5=motionmode_2, Data6=transformto, Data7=rotate)

# ---- group: Second part of the program: 'trace' a vertical square with relative motions.
merge_2 = Merge(Data1=motionmode, Data2=speedto, Data3=precisionto, Data4=move, Data5=move_2, Data6=move_3, Data7=move_4, Data8=wait)

# ---- group: Third part: go back 'home' setting joint rotation values.
merge_3 = Merge(Data1=message_2, Data2=speedto_2, Data3=axesto_2)

# ---- group: Combine program parts and flatten all the actions into a single Program
merge_4 = Merge(Data1=merge, Data2=merge_2, Data3=merge_3)
panel = Panel(merge_4)

# ---- group: Stream the program directly to the robot via the Machina Bridge
# Check these tutorials on how to set up real-time control with your machine: https://www.youtube.com/playlist?list=PLvxxYImPCApXj3tHVKmpTS_AuMPngnA47
connect_to_bridge = BooleanToggle(False)
send_program_to_bridge = Button()
connect = Connect(URL="ws://127.0.0.1:6999/Bridge", Name="Grasshopper", Connect=connect_to_bridge)  # -> Status, Bridge
panel_2 = Panel(connect.Status)
listen = Listen(Bridge=connect.Bridge, Autoupdate=True, Interval=66)
send = Send(Bridge=connect.Bridge, Actions=merge_4, Send=send_program_to_bridge)  # -> Sent, Instructions
panel_3 = Panel(send.Sent)
panel_4 = Panel(send.Instructions)
actionexecuted = ActionExecuted(BridgeMessage=listen)  # -> LastAction, ActionTCP, ActionAxes, ActionExternalAxes, PendingActions, PendingActionsOnDevice
panel_5 = Panel(actionexecuted.LastAction)
data_recorder = DataRecorder(actionexecuted.ActionTCP, DataLimit=-10, RecordData=True)
panel_6 = Panel(actionexecuted.PendingActions)
plane = Plane(data_recorder)

# ---- group: Create a new Robot
createrobot = CreateRobot(Name="VerticalSquare", Brand="ABB")

# ---- group: Generate native Robot Program from a list of Actions
compileprogram = CompileProgram(Robot=createrobot, Actions=merge_4, InLineTargets=Toggle(True), Comments=Toggle(True))

# ---- group: Visualize the Program in native code
displayprogram = DisplayProgram(RobotProgram=compileprogram)
panel_7 = Panel(displayprogram)

# ---- group: Save the Robot Program to this definition's folder
c_script = CSharpScript()  # -> out, here
# ---------- c_script: C# usings ----------
using System.IO;
# ---------- c_script: C# ----------
    string targetFolder = "";

    GH_Document gh_d = owner.OnPingDocument();
    if (gh_d.IsFilePathDefined)
    {
      string ghFilePath = gh_d.FilePath;
      targetFolder = Path.GetDirectoryName(ghFilePath);
    }
    else
    {
      Print("No local folder found, please save your file locally.");
    }

    here = targetFolder;
# ---------- end c_script ----------
saveprogram = SaveProgram(Robot=createrobot, RobotProgram=compileprogram, Path=c_script.here)
panel_8 = Panel(saveprogram)
