# Grasshopper definition 05_ToolChange.gh (Grasshopper 1.0.7)
# plug-ins: Machina

# ---- group: Motion/Program Parameters
tracing_approach_distance = Slider(25, range=0..100)
travel_speed = Slider(100, range=0..100)
approach_speed = Slider(100, range=0..100)
trace_speed = Slider(25, range=0..100)
travel_precision = Slider(5, range=0..10)
approach_precision = Slider(3, range=0..10)
trace_precision = Slider(1, range=0..10)
attach_wait_time = Slider(2500, range=0..10000)
trace_wait_time = Slider(1000, range=0..10000)

# ---- group: Create a Tool object representing a marker
panel = Panel("Marker")
base_point = Point(<point referenced from the Rhino model>)
tool_center_point = Point(<point referenced from the Rhino model>)
xy_plane = XYPlane(Origin=base_point)
xy_plane_2 = XYPlane(Origin=tool_center_point)

# ---- group: Point for tool pickup
construct_point = ConstructPoint(
    XCoordinate=Slider(300, range=-1000..1000),
    YCoordinate=Slider(-300, range=-1000..1000),
    ZCoordinate=Slider(150, range=-1000..1000))

# ----
# A program where the robot picks up a marker,
# draws a shape and puts it back in its holder.
polyline_to_trace = Curve(<curve referenced from the Rhino model>)

# ---- group: Point for tool approach
distance = Distance(PointA=xy_plane, PointB=xy_plane_2)
unit_z = UnitZ(Factor=distance)
move = Move(Geometry=construct_point, Motion=unit_z)  # -> Geometry, Transform

# ---- group: Tool tip point
negative = Negative(Value=distance)
unit_z_2 = UnitZ(Factor=negative)
move_2 = Move(Geometry=construct_point, Motion=unit_z_2)  # -> Geometry, Transform

# ---- group: Generate waypoints for toolpath
control_points = ControlPoints(Curve=polyline_to_trace)  # -> Points, Weights, Knots
list_length = ListLength(List=control_points.Points)
expression = Expression(x=list_length, Expression="x-1")
list_item = ListItem(List=control_points.Points, Index="0", Wrap=True)
unit_z_3 = UnitZ(Factor=tracing_approach_distance)
list_item_2 = ListItem(List=control_points.Points, Index=expression, Wrap=True)
move_3 = Move(Geometry=list_item, Motion=unit_z_3)  # -> Geometry, Transform
move_4 = Move(Geometry=list_item_2, Motion=unit_z_3)  # -> Geometry, Transform

# ----
xy_plane_3 = XYPlane(Origin=move.Geometry)
deconstruct_plane = DeconstructPlane(Plane=xy_plane_3)  # -> Origin, XAxis, YAxis, ZAxis
rotate_3d = Rotate3D(Geometry=xy_plane_3, Angle=degrees("180"), Center=deconstruct_plane.Origin, Axis=deconstruct_plane.YAxis)  # -> Geometry, Transform

# ---- group: Welcome message
message = Message(Message="Let's grab the marker!")

# ---- group: Ramp up and approach toolpath entry point
message_2 = Message(Message="Now, let's draw!")
moveto = MoveTo(Point=move_3.Geometry, Relative=False)  # -> flatten(Action)
precisionto = PrecisionTo(Radius=travel_precision, Relative=False)
speedto = SpeedTo(Speed=travel_speed, Relative=False)
motionmode = MotionMode(MotionMode=1)

# ---- group: Speed up and move to the approach point above the marker
message_3 = Message(Message="Housekeeping: put the tool back in place")
precisionto_2 = PrecisionTo(Radius=travel_precision, Relative=False)
speedto_2 = SpeedTo(Speed=travel_speed, Relative=False)
moveto_2 = MoveTo(Point=move.Geometry, Relative=False)

# ---- group: Speed things up again and go back home
precisionto_3 = PrecisionTo(Radius=travel_precision, Relative=False)
speedto_3 = SpeedTo(Speed=travel_speed, Relative=False)
axesto = AxesTo(A1="0", A2="0", A3="0", A4="0", A5="90", A6="0", Relative=False)

# ---- group: Move to the tool, attach it and wait a little
definetool = DefineTool(Name=panel, BasePlane=xy_plane, TCPPlane=xy_plane_2, Weight=1)
moveto_3 = MoveTo(Point=construct_point, Relative=False)
wait = Wait(Time=attach_wait_time)
attach = Attach(Tool=panel)

# ---- group: Slow down and trace all the points
moveto_4 = MoveTo(Point=control_points.Points, Relative=False)  # -> flatten(Action)
precisionto_4 = PrecisionTo(Radius=trace_precision, Relative=False)
speedto_4 = SpeedTo(Speed=trace_speed, Relative=False)
motionmode_2 = MotionMode(MotionMode=0)

# ---- group: Set initial speed and precision and movement type
precisionto_5 = PrecisionTo(Radius=travel_precision, Relative=False)
speedto_5 = SpeedTo(Speed=travel_speed, Relative=False)
motionmode_3 = MotionMode(MotionMode=1)

# ---- group: Move to the approach point above the marker
transformto = TransformTo(Plane=rotate_3d.Geometry, Relative=False)

# ---- group: Slow down and approach the marker linearly
precisionto_6 = PrecisionTo(Radius=approach_precision, Relative=False)
speedto_6 = SpeedTo(Speed=approach_speed, Relative=False)
motionmode_4 = MotionMode(MotionMode=0)

# ---- group: Slow down and approach the marker drop position
precisionto_7 = PrecisionTo(Radius=approach_precision, Relative=False)
speedto_7 = SpeedTo(Speed=approach_speed, Relative=False)
moveto_5 = MoveTo(Point=move_2.Geometry, Relative=False)

# ---- group: Move back to the approach point
moveto_6 = MoveTo(Point=move.Geometry, Relative=False)

# ---- group: Move to exit point and wait a little
moveto_7 = MoveTo(Point=move_4.Geometry, Relative=False)  # -> flatten(Action)
wait_2 = Wait(Time=trace_wait_time)

# ---- group: Detach the tool and wait
wait_3 = Wait(Time=attach_wait_time)
detach = Detach()

# ---- group: Move back to the approach point
moveto_8 = MoveTo(Point=move.Geometry, Relative=False)

# ---- group: Approach the tool and attach it
merge = Merge(
    Data1=message,
    Data2=speedto_5,
    Data3=precisionto_5,
    Data4=motionmode_3,
    Data5=transformto,
    Data6=speedto_6,
    Data7=precisionto_6,
    Data8=motionmode_4,
    Data9=moveto_3,
    Data10=definetool,
    Data11=attach,
    Data12=wait,
    Data13=moveto_6)
panel_2 = Panel(merge)

# ---- group: Go to the toolpath and trace it with the marker
merge_2 = Merge(
    Data1=message_2,
    Data2=speedto,
    Data3=precisionto,
    Data4=motionmode,
    Data5=moveto,
    Data6=speedto_4,
    Data7=precisionto_4,
    Data8=motionmode_2,
    Data9=moveto_4,
    Data10=moveto_7,
    Data11=wait_2)
panel_3 = Panel(merge_2)

# ---- group: Go back to the tool holder and detach it
merge_3 = Merge(
    Data1=message_3,
    Data2=speedto_2,
    Data3=precisionto_2,
    Data4=moveto_2,
    Data5=speedto_7,
    Data6=precisionto_7,
    Data7=moveto_5,
    Data8=detach,
    Data9=wait_3,
    Data10=moveto_8)
panel_4 = Panel(merge_3)

# ---- group: Go back home
merge_4 = Merge(Data1=speedto_3, Data2=precisionto_3, Data3=axesto)
panel_5 = Panel(merge_4)

# ---- group: Combine program parts and flatten all the actions into a single Program
merge_5 = Merge(Data1=merge, Data2=merge_2, Data3=merge_3, Data4=merge_4)
panel_6 = Panel(merge_5)

# ---- group: Create a new Robot
createrobot = CreateRobot(Name="Tracer", Brand="ABB")

# ---- group: Generate native Robot Program from a list of Actions
compileprogram = CompileProgram(Robot=createrobot, Actions=merge_5, InLineTargets=Toggle(True), Comments=Toggle(False))

# ---- group: Visualize the Program in native code
displayprogram = DisplayProgram(RobotProgram=compileprogram)
panel_7 = Panel(displayprogram)

# ---- group: Save the Robot Program to this definition's folder
c_script = CSharpScript()  # -> out, here
# ---------- c_script: C# usings ----------
using System.IO;
# ---------- c_script: C# ----------
    string targetFolder = "";

    GH_Document gh_d = owner.OnPingDocument();
    if (gh_d.IsFilePathDefined)
    {
      string ghFilePath = gh_d.FilePath;
      targetFolder = Path.GetDirectoryName(ghFilePath);
    }
    else
    {
      Print("No local folder found, please save your file locally.");
    }

    here = targetFolder;
# ---------- end c_script ----------
saveprogram = SaveProgram(Robot=createrobot, RobotProgram=compileprogram, Path=c_script.here)
panel_8 = Panel(saveprogram)

# ---- group: Stream the program directly to the robot via the Machina Bridge
# Check these tutorials on how to set up real-time control with your machine: https://www.youtube.com/playlist?list=PLvxxYImPCApXj3tHVKmpTS_AuMPngnA47
connect_to_bridge = BooleanToggle(False)
send_program_to_bridge = Button()
connect = Connect(URL="ws://127.0.0.1:6999/Bridge", Name="Grasshopper", Connect=connect_to_bridge)  # -> Status, Bridge
panel_9 = Panel(connect.Status)
listen = Listen(Bridge=connect.Bridge, Autoupdate=True, Interval=66)
send = Send(Bridge=connect.Bridge, Actions=merge_5, Send=send_program_to_bridge)  # -> Sent, Instructions
panel_10 = Panel(send.Sent)
panel_11 = Panel(send.Instructions)
actionexecuted = ActionExecuted(BridgeMessage=listen)  # -> LastAction, ActionTCP, ActionAxes, ActionExternalAxes, PendingActions, PendingActionsOnDevice
panel_12 = Panel(actionexecuted.LastAction)
panel_13 = Panel(actionexecuted.PendingActions)

# ----
data_recorder = DataRecorder(actionexecuted.ActionTCP, DataLimit=-10, RecordData=True)

# ---- group: Stream the program directly to the robot via the Machina Bridge (continued)
plane = Plane(data_recorder)
