# Grasshopper definition 06_SurfaceMilling.gh (Grasshopper 1.0.7)
# plug-ins: Machina

surface_definition = Slider(3, range=0..50)
mill_bit_height = Slider(50, range=0..1000)
precision = Slider(2, range=0..10)
travel_speed = Slider(200, range=0..200)
lead_speed = Slider(75, range=0..200)
lead_distance = Slider(30, range=0..200)
milling_speed = Slider(25, range=0..200)
# A program where the robot mills a virtual surface
surface = Surface(<surface referenced from the Rhino model>)

expression = Expression(x=surface_definition, Expression="x+1")

# ---- group: Milling planes
surface_frames = SurfaceFrames(Surface=surface, UCount=surface_definition, VCount=surface_definition)  # -> Frames, Parameters

# ---- group: Compose string messages for each toolpath
series = Series(Start=0, Step=1, Count=expression)
integer = Integer(series)
concatenate = Concatenate(FragmentA="Starting path #", FragmentB=integer)

# ---- group: Set speeds for approach
duplicate_data = DuplicateData(Data=lead_speed, Number=expression, Order=True)

# ---- group: Set speeds for milling
duplicate_data_2 = DuplicateData(Data=milling_speed, Number=expression, Order=True)

# ---- group: Set speeds for each toolpath
duplicate_data_3 = DuplicateData(Data=travel_speed, Number=expression, Order=True)

# ---- group: Planes for retreat
list_item = ListItem(List=surface_frames.Frames, Index=surface_definition, Wrap=True)
plane_offset = PlaneOffset(BasePlane=list_item, Offset=lead_distance)

# ---- group: Lead planes
list_item_2 = ListItem(List=surface_frames.Frames, Index=0, Wrap=True)
plane_offset_2 = PlaneOffset(BasePlane=list_item_2, Offset=lead_distance)

# ---- group: Create Actions for each toolpath: message, approach, mill and retreat
message = Message(Message=concatenate)  # -> graft(Action)
speedto = SpeedTo(Speed=duplicate_data, Relative=False)  # -> graft(Action)
speedto_2 = SpeedTo(Speed=duplicate_data_2, Relative=False)  # -> graft(Action)
speedto_3 = SpeedTo(Speed=duplicate_data, Relative=False)  # -> graft(Action)
transformto = TransformTo(Plane=plane_offset_2, Relative=False)
transformto_2 = TransformTo(Plane=list_item_2, Relative=False)
transformto_3 = TransformTo(Plane=surface_frames.Frames, Relative=False)
transformto_4 = TransformTo(Plane=plane_offset, Relative=False)

# ----
speedto_4 = SpeedTo(Speed=duplicate_data_3, Relative=False)  # -> graft(Action)
precisionto = PrecisionTo(Radius=precision, Relative=False)

# ---- group: Slow down and go back home
speedto_5 = SpeedTo(Speed=travel_speed, Relative=False)
axesto = AxesTo(A1="0", A2="0", A3="0", A4="0", A5="90", A6="0", Relative=False)

# ---- group: Create a new Robot
createrobot = CreateRobot(Name="SurfaceMilling", Brand="ABB")

# ---- group: Create a Tool representing a milling bit
xy_plane = XYPlane(Origin=Point(0, 0, 0))
panel = Panel("MillingBit")

# ---- group: Tool Center Plane is rotated 180deg around Y to match the orientation of the surface planes
unit_y = UnitY(Factor=1)
plane_offset_3 = PlaneOffset(BasePlane=xy_plane, Offset=mill_bit_height)
rotate_3d = Rotate3D(Geometry=plane_offset_3, Angle=degrees("180"), Center=plane_offset_3, Axis=unit_y)  # -> Geometry, Transform

# ---- group: Create a Tool representing a milling bit (continued)
definetool = DefineTool(Name=panel, BasePlane=xy_plane, TCPPlane=rotate_3d.Geometry, Weight=1)

# ---- group: Attach the milling tool at the beginning of the program to use it throughout
attach = Attach(Tool=panel)

# ----
panel_2 = Panel(definetool)
panel_3 = Panel(attach)

# ---- group: Combine actions and merge them into a program
merge = Merge(
    Data1=message,
    Data2=speedto_4,
    Data3=transformto,
    Data4=speedto,
    Data5=transformto_2,
    Data6=speedto_2,
    Data7=transformto_3,
    Data8=speedto_3,
    Data9=transformto_4)
flatten_tree = FlattenTree(Tree=merge, Path="{0}")
merge_2 = Merge(Data1=definetool, Data2=attach, Data3=precisionto, Data4=flatten_tree, Data5=speedto_5, Data6=axesto)
panel_4 = Panel(merge_2)

# ---- group: Generate native Robot Program from a list of Actions
compileprogram = CompileProgram(Robot=createrobot, Actions=merge_2, InLineTargets=Toggle(True), Comments=Toggle(False))

# ---- group: Visualize the Program in native code
displayprogram = DisplayProgram(RobotProgram=compileprogram)
panel_5 = Panel(displayprogram)

# ---- group: Save the Robot Program to this definition's folder
c_script = CSharpScript()  # -> out, here
# ---------- c_script: C# usings ----------
using System.IO;
# ---------- c_script: C# ----------
    string targetFolder = "";

    GH_Document gh_d = owner.OnPingDocument();
    if (gh_d.IsFilePathDefined)
    {
      string ghFilePath = gh_d.FilePath;
      targetFolder = Path.GetDirectoryName(ghFilePath);
    }
    else
    {
      Print("No local folder found, please save your file locally.");
    }

    here = targetFolder;
# ---------- end c_script ----------
saveprogram = SaveProgram(Robot=createrobot, RobotProgram=compileprogram, Path=c_script.here)
panel_6 = Panel(saveprogram)

# ---- group: Stream the program directly to the robot via the Machina Bridge
# Check these tutorials on how to set up real-time control with your machine: https://www.youtube.com/playlist?list=PLvxxYImPCApXj3tHVKmpTS_AuMPngnA47
connect_to_bridge = BooleanToggle(False)
send_program_to_bridge = Button()
connect = Connect(URL="ws://127.0.0.1:6999/Bridge", Name="Grasshopper", Connect=connect_to_bridge)  # -> Status, Bridge
panel_7 = Panel(connect.Status)
listen = Listen(Bridge=connect.Bridge, Autoupdate=True, Interval=66)
send = Send(Bridge=connect.Bridge, Actions=merge_2, Send=send_program_to_bridge)  # -> Sent, Instructions
panel_8 = Panel(send.Sent)
panel_9 = Panel(send.Instructions)
actionexecuted = ActionExecuted(BridgeMessage=listen)  # -> LastAction, ActionTCP, ActionAxes, ActionExternalAxes, PendingActions, PendingActionsOnDevice
panel_10 = Panel(actionexecuted.LastAction)
panel_11 = Panel(actionexecuted.PendingActions)

# ----
data_recorder = DataRecorder(actionexecuted.ActionTCP, DataLimit=-10, RecordData=True)

# ---- group: Stream the program directly to the robot via the Machina Bridge (continued)
plane = Plane(data_recorder)
