# Grasshopper definition 02_SimpleProgram_VerticalLine.gh (Grasshopper 1.0.7)
# plug-ins: Machina

# ---- group: Transform to base plane (inverted to match robot's TCP orientation)
# A simple program that traces a vertical line in space
number_slider = Slider(400, range=0..1000)
construct_point = ConstructPoint(XCoordinate=number_slider, YCoordinate=Slider(200, range=0..1000), ZCoordinate=Slider(500, range=0..1000))
xy_plane = XYPlane(Origin=construct_point)
deconstruct_plane = DeconstructPlane(Plane=xy_plane)  # -> Origin, XAxis, YAxis, ZAxis
rotate_3d = Rotate3D(Geometry=xy_plane, Angle=degrees("180"), Center=deconstruct_plane.Origin, Axis=deconstruct_plane.YAxis)  # -> Geometry, Transform
transformto = TransformTo(Plane=rotate_3d.Geometry, Relative=False)

# ---- group: Move along vector relative to where Robot is right now
unit_z = UnitZ(Factor=Slider(250, range=0..1000))
move = Move(Vector=unit_z, Relative=True)

# ---- group: Set initial Speed
speedto = SpeedTo(Speed=Slider(100, range=0..100), Relative=False)

# ---- group: Rotate tobot flange around the Y Axis
unit_y = UnitY(Factor=1)
rotate = Rotate(Axis=unit_y, Angle=Slider(-90, range=-100..100), Relative=True)

# ---- group: Slow down
speedto_2 = SpeedTo(Speed=Slider(50, range=-100..100), Relative=False)

# ---- group: Wait a bit before continuing
wait = Wait(Time=Slider(2500, range=0..5000))

# ---- group: Fast again
speedto_3 = SpeedTo(Speed=Slider(100, range=0..100), Relative=False)

# ---- group: Start message ;)
message = Message(Message="Let's do some robots!")

# ---- group: Go back to a 'home' position using joint rotation values directly
axesto = AxesTo(A1="0", A2="0", A3="0", A4="0", A5="90", A6="0", Relative=False)

# ---- group: Merge actions into a list and display them
merge = Merge(
    Data1=message,
    Data2=speedto,
    Data3=transformto,
    Data4=rotate,
    Data5=speedto_2,
    Data6=move,
    Data7=wait,
    Data8=speedto_3,
    Data9=axesto)
panel = Panel(merge)

# ---- group: Stream the program directly to the robot via the Machina Bridge
# Check these tutorials on how to set up real-time control with your machine: https://www.youtube.com/playlist?list=PLvxxYImPCApXj3tHVKmpTS_AuMPngnA47
connect_to_bridge = BooleanToggle(False)
send_program_to_bridge = Button()
connect = Connect(URL="ws://127.0.0.1:6999/Bridge", Name="Grasshopper", Connect=connect_to_bridge)  # -> Status, Bridge
panel_2 = Panel(connect.Status)
listen = Listen(Bridge=connect.Bridge, Autoupdate=True, Interval=66)
send = Send(Bridge=connect.Bridge, Actions=merge, Send=send_program_to_bridge)  # -> Sent, Instructions
panel_3 = Panel(send.Sent)
panel_4 = Panel(send.Instructions)
actionexecuted = ActionExecuted(BridgeMessage=listen)  # -> LastAction, ActionTCP, ActionAxes, ActionExternalAxes, PendingActions, PendingActionsOnDevice
panel_5 = Panel(actionexecuted.LastAction)
data_recorder = DataRecorder(actionexecuted.ActionTCP, DataLimit=-10, RecordData=True)
panel_6 = Panel(actionexecuted.PendingActions)
plane = Plane(data_recorder)

# ---- group: Create a new Robot
createrobot = CreateRobot(Name="VerticalLine", Brand="ABB")

# ---- group: Generate native Robot Program from a list of Actions
compileprogram = CompileProgram(Robot=createrobot, Actions=merge, InLineTargets=Toggle(True), Comments=Toggle(True))

# ---- group: Visualize the Program in native code
displayprogram = DisplayProgram(RobotProgram=compileprogram)
panel_7 = Panel(displayprogram)

# ---- group: Save the Robot Program to this definition's folder
c_script = CSharpScript()  # -> out, here
# ---------- c_script: C# usings ----------
using System.IO;
# ---------- c_script: C# ----------
    string targetFolder = "";

    GH_Document gh_d = owner.OnPingDocument();
    if (gh_d.IsFilePathDefined)
    {
      string ghFilePath = gh_d.FilePath;
      targetFolder = Path.GetDirectoryName(ghFilePath);
    }
    else
    {
      Print("No local folder found, please save your file locally.");
    }

    here = targetFolder;
# ---------- end c_script ----------
saveprogram = SaveProgram(Robot=createrobot, RobotProgram=compileprogram, Path=c_script.here)
panel_8 = Panel(saveprogram)
