# Grasshopper definition 07_3DPrinting.gh (Grasshopper 1.0.7)
# plug-ins: Machina

waypoints_per_layer = Slider(64, range=0..1000)
# A program where the robot 3D prints a surface
surface = Surface(<surface referenced from the Rhino model>)
layer_height = Slider(3, range=0..10)

robot_name = Panel("PrinterArm")
robot_brand = Panel("ABB")

tool_weigth_kg = Slider(5, range=0..10)
tool_name = Panel("ExtruderTool")
tool_io = Panel("ExtruderIO")
tool_center_point = Point(<point referenced from the Rhino model>)
base_point = Point(<point referenced from the Rhino model>)

travel_speed = Slider(200, range=0..200)
travel_precision = Slider(10, range=0..10)
print_speed = Slider(100, range=0..100)
print_precision = Slider(10, range=0..10)

# ---- group: Discretize the geometry into toolpaths and target Planes for 3D printing
bounding_box = BoundingBox(Content=surface, Plane=PlaneXY(0, 0, 0))  # -> Box, Box_2
box_properties = BoxProperties(Box=bounding_box.Box)  # -> Center, Diagonal, Area, Volume, Degeneracy
deconstruct_vector = DeconstructVector(Vector=box_properties.Diagonal)  # -> XComponent, YComponent, ZComponent
expression = Expression(a=deconstruct_vector.ZComponent, Expression="a/2")
negative = Negative(Value=expression)
unit_z = UnitZ(Factor=negative)
expression_2 = Expression(a=deconstruct_vector.ZComponent, b=layer_height, Expression="ceiling(a / b)")
move = Move(Geometry=box_properties.Center, Motion=unit_z)  # -> Geometry, Transform
series = Series(Start=0, Step=layer_height, Count=expression_2)
xy_plane = XYPlane(Origin=move.Geometry)
unit_z_2 = UnitZ(Factor=series)
move_2 = Move(Geometry=xy_plane, Motion=unit_z_2)  # -> Geometry, Transform
brep_plane = BrepPlane(Brep=surface, Plane=move_2.Geometry)  # -> Curves, Points
divide_curve = DivideCurve(Curve=brep_plane.Curves, Count=waypoints_per_layer, Kinks=False)  # -> Points, Tangents, Parameters
xy_plane_2 = XYPlane(Origin=divide_curve.Points)
plane = Plane(xy_plane_2)

# ---- group: Tool Center Plane: note the plane reorientation to match the orientation of the target Planes
unit_z_3 = UnitZ(Factor=1)
unit_y = UnitY(Factor=1)
construct_plane = ConstructPlane(Origin=tool_center_point, XAxis=unit_z_3, YAxis=unit_y)

# ---- group: Tool Base Plane
xy_plane_3 = XYPlane(Origin=base_point)

# ----
flatten_tree = FlattenTree(Tree=plane, Path="{0}")
list_item = ListItem(List=flatten_tree, Index=0, Wrap=True)

# ---- group: Tool definition
definetool = DefineTool(Name=tool_name, BasePlane=xy_plane_3, TCPPlane=construct_plane, Weight=tool_weigth_kg)

# ---- group: Turn extruder Tool on
writedigital = WriteDigital(DigitalPin=tool_io, On=Toggle(True), ToolPin=False)

# ---- group: Turn extruder Tool off
writedigital_2 = WriteDigital(DigitalPin=tool_io, On=Toggle(False), ToolPin=False)

# ---- group: Robot creation
createrobot = CreateRobot(Name=robot_name, Brand=robot_brand)

# ---- group: Speed up and go to the first target
precisionto = PrecisionTo(Radius=travel_precision, Relative=False)
speedto = SpeedTo(Speed=travel_speed, Relative=False)
transformto = TransformTo(Plane=list_item, Relative=False)

# ---- group: Slow down and go over all target Planes
precisionto_2 = PrecisionTo(Radius=print_precision, Relative=False)
speedto_2 = SpeedTo(Speed=print_speed, Relative=False)
transformto_2 = TransformTo(Plane=flatten_tree, Relative=False)

# ---- group: Speed up and go back home
precisionto_3 = PrecisionTo(Radius=travel_precision, Relative=False)
speedto_3 = SpeedTo(Speed=travel_speed, Relative=False)
axesto = AxesTo(A1="0", A2="0", A3="0", A4="0", A5="90", A6="0", Relative=False)

# ---- group: Attach the Tool at the beginning of the program
attach = Attach(Tool=tool_name)

# ---- group: Combine actions and merge them into a program
merge = Merge(
    Data1=definetool,
    Data2=attach,
    Data3=speedto,
    Data4=precisionto,
    Data5=transformto,
    Data6=writedigital,
    Data7=speedto_2,
    Data8=precisionto_2,
    Data9=transformto_2,
    Data10=writedigital_2,
    Data11=speedto_3,
    Data12=precisionto_3,
    Data13=axesto)
panel = Panel(merge)

# ---- group: Generate native Robot Program from a list of Actions
compileprogram = CompileProgram(Robot=createrobot, Actions=merge, InLineTargets=Toggle(True), Comments=Toggle(False))

# ---- group: Visualize the Program in native code
displayprogram = DisplayProgram(RobotProgram=compileprogram)
panel_2 = Panel(displayprogram)

# ---- group: Save the Robot Program to this definition's folder
c_script = CSharpScript()  # -> out, here
# ---------- c_script: C# usings ----------
using System.IO;
# ---------- c_script: C# ----------
    string targetFolder = "";

    GH_Document gh_d = owner.OnPingDocument();
    if (gh_d.IsFilePathDefined)
    {
      string ghFilePath = gh_d.FilePath;
      targetFolder = Path.GetDirectoryName(ghFilePath);
    }
    else
    {
      Print("No local folder found, please save your file locally.");
    }

    here = targetFolder;
# ---------- end c_script ----------
saveprogram = SaveProgram(Robot=createrobot, RobotProgram=compileprogram, Path=c_script.here)
panel_3 = Panel(saveprogram)

# ---- group: Stream the program directly to the robot via the Machina Bridge
# Check these tutorials on how to set up real-time control with your machine: https://www.youtube.com/playlist?list=PLvxxYImPCApXj3tHVKmpTS_AuMPngnA47
connect_to_bridge = BooleanToggle(False)
send_program_to_bridge = Button()

# ----
connect = Connect(URL="ws://127.0.0.1:6999/Bridge", Name="GH", Connect=connect_to_bridge)  # -> Status, Bridge

# ---- group: Stream the program directly to the robot via the Machina Bridge (continued)
panel_4 = Panel(connect.Status)
listen = Listen(Bridge=connect.Bridge, Autoupdate=True, Interval=66)
send = Send(Bridge=connect.Bridge, Actions=merge, Send=send_program_to_bridge)  # -> Sent, Instructions
panel_5 = Panel(send.Sent)
panel_6 = Panel(send.Instructions)
actionexecuted = ActionExecuted(BridgeMessage=listen)  # -> LastAction, ActionTCP, ActionAxes, ActionExternalAxes, PendingActions, PendingActionsOnDevice
panel_7 = Panel(actionexecuted.LastAction)
data_recorder = DataRecorder(actionexecuted.ActionTCP, DataLimit=-10, RecordData=True)
panel_8 = Panel(actionexecuted.PendingActions)
plane_2 = Plane(data_recorder)
