# Grasshopper definition 08_Interactive3DPrinting.gh (Grasshopper 1.0.7)
# plug-ins: Machina

waypoints_per_layer = Slider(12, range=0..1000)
# A program where the robot 3D prints a surface,
# accepting modifications of the surface on the fly as it is printing! :)
surface = Surface(<surface referenced from the Rhino model>)
layer_height = Slider(12, range=0..100)

robot_name = Panel("PrinterArm")
robot_brand = Panel("ABB")

tool_weigth_kg = Slider(5, range=0..10)
tool_name = Panel("ExtruderTool")
tool_io = Panel("ExtruderIO")
tool_center_point = Point(<point referenced from the Rhino model>)
base_point = Point(<point referenced from the Rhino model>)

travel_speed = Slider(200, range=0..200)
travel_precision = Slider(10, range=0..10)
print_speed = Slider(75, range=0..100)
print_precision = Slider(10, range=0..10)

# ---- group: Tool Center Plane: note the plane reorientation to match the orientation of the target Planes
unit_z = UnitZ(Factor=1)
unit_y = UnitY(Factor=1)
construct_plane = ConstructPlane(Origin=tool_center_point, XAxis=unit_z, YAxis=unit_y)

# ---- group: Tool Base Plane
xy_plane = XYPlane(Origin=base_point)

# ---- group: Robot creation
createrobot = CreateRobot(Name=robot_name, Brand=robot_brand)

# ---- group: Turn extruder Tool on
writedigital = WriteDigital(DigitalPin=tool_io, On=Toggle(True), ToolPin=False)

# ---- group: Tool definition
definetool = DefineTool(Name=tool_name, BasePlane=xy_plane, TCPPlane=construct_plane, Weight=tool_weigth_kg)

# ---- group: Turn extruder Tool off
writedigital_2 = WriteDigital(DigitalPin=tool_io, On=Toggle(False), ToolPin=False)

# ---- group: Speed up and go back home
precisionto = PrecisionTo(Radius=travel_precision, Relative=False)
speedto = SpeedTo(Speed=travel_speed, Relative=False)
axesto = AxesTo(A1="0", A2="0", A3="0", A4="0", A5="90", A6="0", Relative=False)

# ---- group: Attach the Tool at the beginning of the program
attach = Attach(Tool=tool_name)

# ----
merge = Merge(Data1=writedigital_2, Data2=speedto, Data3=precisionto, Data4=axesto)
tree_statistics = TreeStatistics(Tree=merge)  # -> Paths, Length, Count
param_viewer = ParamViewer(merge)

# ---- group: BRIDGE CONNECTION
connect = Connect(URL="ws://127.0.0.1:6999/Bridge", Name="Grasshopper", Connect=Toggle(False))  # -> Messages, Bridge
panel = Panel(connect.Messages)

# ---- group: Discretize the geometry into toolpaths and target Planes for 3D printing
bounding_box = BoundingBox(Content=surface, Plane=PlaneXY(0, 0, 0))  # -> Box, Box_2
box_properties = BoxProperties(Box=bounding_box.Box)  # -> Center, Diagonal, Area, Volume, Degeneracy
deconstruct_vector = DeconstructVector(Vector=box_properties.Diagonal)  # -> XComponent, YComponent, ZComponent

# ----
division = Division(A=deconstruct_vector.ZComponent, B="2")
division_2 = Division(A=deconstruct_vector.ZComponent, B=layer_height)
round = Round(Number=division_2)  # -> Nearest, Floor, Ceiling

# ---- group: Discretize the geometry into toolpaths and target Planes for 3D printing (continued)
negative = Negative(Value=division)
unit_z_2 = UnitZ(Factor=negative)
move = Move(Geometry=box_properties.Center, Motion=unit_z_2)  # -> Geometry, Transform
series = Series(Start=0, Step=layer_height, Count=round.Ceiling)
xy_plane_2 = XYPlane(Origin=move.Geometry)
unit_z_3 = UnitZ(Factor=series)
move_2 = Move(Geometry=xy_plane_2, Motion=unit_z_3)  # -> Geometry, Transform
brep_plane = BrepPlane(Brep=surface, Plane=move_2.Geometry)  # -> Curves, Points
divide_curve = DivideCurve(Curve=brep_plane.Curves, Count=waypoints_per_layer, Kinks=False)  # -> Points, Tangents, Parameters
xy_plane_3 = XYPlane(Origin=divide_curve.Points)
plane = Plane(xy_plane_3)

# ----
flatten_tree = FlattenTree(Tree=plane, Path="{0}")
list_item = ListItem(List=flatten_tree, Index=0, Wrap=True)

# ---- group: Speed up and go to the first target
precisionto_2 = PrecisionTo(Radius=travel_precision, Relative=False)
speedto_2 = SpeedTo(Speed=travel_speed, Relative=False)
transformto = TransformTo(Plane=list_item, Relative=False)

# ---- group: Slow down and go over all target Planes
precisionto_3 = PrecisionTo(Radius=print_precision, Relative=False)
speedto_3 = SpeedTo(Speed=print_speed, Relative=False)
transformto_2 = TransformTo(Plane=plane, Relative=False)  # -> simplify(Action)

# ----
path_mapper = PathMapper(transformto_2, source="{a}", target="{a + 1}")
merge_2 = Merge(
    Data1=definetool,
    Data2=attach,
    Data3=speedto_2,
    Data4=precisionto_2,
    Data5=transformto,
    Data6=writedigital,
    Data7=speedto_3,
    Data8=precisionto_3)
tree_statistics_2 = TreeStatistics(Tree=transformto_2)  # -> Paths, Length, Count
addition = Addition(A="1", B=tree_statistics_2.Count)
construct_path = ConstructPath(Indices=addition)
replace_paths = ReplacePaths(Data=merge, Search=tree_statistics.Paths, Replace=construct_path)
param_viewer_2 = ParamViewer(replace_paths)

# ---- group: Combine actions and merge them into a program
merge_3 = Merge(Data1=merge_2, Data2=path_mapper, Data3=replace_paths)
panel_2 = Panel(merge_3)

# ---- group: BRIDGE LISTENERS
newlisten = NewListen(Bridge=connect.Bridge, Autoupdate=Toggle(True), Interval=Slider(33, range=0..100))
data_recorder = DataRecorder(newlisten, DataLimit=-10, RecordData=True)
panel_3 = Panel(data_recorder)

# ----
actionexecuted = ActionExecuted(BridgeMessage=newlisten)  # -> LastAction, ActionTCP, ActionAxes, ActionExternalAxes, PendingActions, PendingActionsOnDevice

# ---- group: Real-time motion tracking (if available)
motionupdate = MotionUpdate(BridgeMessage=newlisten)  # -> ActionTCP, ActionAxes, ActionExternalAxes
data_recorder_2 = DataRecorder(motionupdate.ActionTCP, DataLimit=-10, RecordData=True)
deconstruct_plane = DeconstructPlane(Plane=data_recorder_2)  # -> Origin, XAxis, YAxis, ZAxis
interpolate = Interpolate(Vertices=deconstruct_plane.Origin, Degree=3, Periodic=False, KnotStyle=1)  # -> Curve, Length, Domain

# ---- group: BRIDGE LISTENERS (continued)
panel_4 = Panel(actionexecuted.PendingActions)
data_recorder_3 = DataRecorder(actionexecuted.ActionTCP, DataLimit=-10, RecordData=True)
deconstruct_plane_2 = DeconstructPlane(Plane=data_recorder_3)  # -> Origin, XAxis, YAxis, ZAxis
interpolate_2 = Interpolate(Vertices=deconstruct_plane_2.Origin, Degree=3, Periodic=False, KnotStyle=1)  # -> Curve, Length, Domain
panel_5 = Panel(data_recorder_3)

# ---- group: CHOOSE WHICH BRANCH TO STREAM AND SEND IT
smaller_than = SmallerThan(FirstNumber=actionexecuted.PendingActions, SecondNumber="0")  # -> SmallerThan, OrEqualTo
boolean = Boolean(smaller_than.OrEqualTo)
c_script = CSharpScript(up=smaller_than.OrEqualTo, reset=Button())  # -> ticks; inputs up: Boolean, reset: Boolean
# ---------- c_script: C# ----------
    if (reset) {
      switchOn = false;
      counter = 0;
      ticks = 0;
      return;
    }

    if (up && !switchOn) {
      counter++;
      switchOn = true;
    }
    else if (!up && switchOn) {
      switchOn = false;
    }

    ticks = counter;
# ---------- c_script: C# additional code ----------
  bool switchOn = false;
  int counter = 0;
# ---------- end c_script ----------
construct_path_2 = ConstructPath(Indices=c_script)
panel_6 = Panel(c_script)
kickstart = Button()
tree_branch = TreeBranch(Tree=merge_3, Path=construct_path_2, MaintainPaths=True)  # -> flatten(Branch)
gate_or = GateOr(A=boolean, B=kickstart)
panel_7 = Panel(tree_branch)
send = Send(Bridge=connect.Bridge, Actions=tree_branch, Send=gate_or)  # -> Sent, Instructions
panel_8 = Panel(send.Instructions)
panel_9 = Panel(send.Sent)
