# Grasshopper definition 09_RobotMotionControlPanel.gh (Grasshopper 1.0.7)
# plug-ins: Machina

# ---- group: ROBOT PARAMETERS
# A simple program to move the robot around with push buttons!
connect_to_machina_bridge = BooleanToggle(False)
motion_precision = Slider(1, range=0..10)
motion_speed = Slider(100, range=0..250)
motion_distance = Slider(50, range=0..1000)

# ---- group: MACHINA BRIDGE CONNECTION
connect = Connect(URL="ws://127.0.0.1:6999/Bridge", Name="Grasshopper", Connect=connect_to_machina_bridge)  # -> Status, Bridge
data = Data(connect.Bridge)

# ---- group: ROBOT MOTION CONTROL PANEL / MOVE DOWN
Z = UnitZ(Factor=expr("-x", motion_distance))
move = Move(Vector=Z, Relative=True)
send = Send(Bridge=data, Actions=move, Send=Button())  # -> Sent, Instructions

# ---- group: ROBOT MOTION CONTROL PANEL / START INITIAL PARAMETERS
speedto = SpeedTo(Speed=motion_speed, Relative=False)
precisionto = PrecisionTo(Radius=motion_precision, Relative=False)
entwine = Entwine(Branch00=speedto, Branch01=precisionto, FlattenInputs=True)  # -> flatten(Result)
send_2 = Send(Bridge=data, Actions=entwine, Send=Button())  # -> Sent, Instructions

# ---- group: ROBOT MOTION CONTROL PANEL / MOVE LEFT
Y = UnitY(Factor=expr("-X", motion_distance))
move_2 = Move(Vector=Y, Relative=True)
send_3 = Send(Bridge=data, Actions=move_2, Send=Button())  # -> Sent, Instructions

# ---- group: ROBOT MOTION CONTROL PANEL / MOVE BACK
X = UnitX(Factor=expr("-X", motion_distance))
move_3 = Move(Vector=X, Relative=True)
send_4 = Send(Bridge=data, Actions=move_3, Send=Button())  # -> Sent, Instructions

# ---- group: ROBOT MOTION CONTROL PANEL / MOVE FRONT
X_2 = UnitX(Factor=motion_distance)
move_4 = Move(Vector=X_2, Relative=True)
send_5 = Send(Bridge=data, Actions=move_4, Send=Button())  # -> Sent, Instructions

# ---- group: ROBOT MOTION CONTROL PANEL / MOVE RIGHT
Y_2 = UnitY(Factor=motion_distance)
move_5 = Move(Vector=Y_2, Relative=True)
send_6 = Send(Bridge=data, Actions=move_5, Send=Button())  # -> Sent, Instructions

# ---- group: ROBOT MOTION CONTROL PANEL / MOVE UP
Z_2 = UnitZ(Factor=motion_distance)
move_6 = Move(Vector=Z_2, Relative=True)
send_7 = Send(Bridge=data, Actions=move_6, Send=Button())  # -> Sent, Instructions
