# Grasshopper definition 04_SimpleToolPath.gh (Grasshopper 0.9.76)
# plug-ins: Machina

# ----
# A program where the robot traces a toolpath,
# maintaing the orientation of the curve's tangency.
curve = Curve(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)

# ---- group: Discretize curve into planes
perp_frames = PerpFrames(Curve=curve, Count=Slider(100, range=0..101), Align=True)  # -> Frames, Parameters
deconstruct_plane = DeconstructPlane(Plane=perp_frames.Frames)  # -> Origin, XAxis, YAxis, ZAxis
rotate_3d = Rotate3D(Geometry=perp_frames.Frames, Angle="-0.5 * PI", Center=deconstruct_plane.Origin, Axis=deconstruct_plane.XAxis)  # -> Geometry, Transform

# ---- group: Create individual Actions
transformto = TransformTo(Plane=rotate_3d.Geometry, Relative=False)  # -> flatten(Action)
precisionto = PrecisionTo(Radius=Slider(2, range=0..10), Relative=False)
speedto = SpeedTo(Speed=Slider(100, range=0..100), Relative=False)
axesto = AxesTo(A1="0", A2="0", A3="0", A4="0", A5="90", A6="0", Relative=False)

# ---- group: Concatenate all Actions into a Program
data = Data([speedto, precisionto, transformto, axesto])
displayprogram = DisplayProgram(Actions=data)
panel = Panel(displayprogram)

# ---- group: Generate native code
createrobot = CreateRobot(Name="toolPather", Brand="ABB")
compileprogram = CompileProgram(Robot=createrobot, Actions=data, InLineTargets=Toggle(True), Comments=Toggle(False))

# ---- group: Stream the program directly to the robot via the Machina Bridge
# Check these tutorials on how to set up real-time control with your machine: https://www.youtube.com/playlist?list=PLvxxYImPCApXj3tHVKmpTS_AuMPngnA47
connect_to_bridge = BooleanToggle(False)
send_program_to_bridge = Button()
connect = Connect(URL="ws://127.0.0.1:6999/Bridge", Name="Grasshopper", Connect=connect_to_bridge)  # -> Status, Bridge
panel_2 = Panel(connect.Status)
listen = Listen(Bridge=connect.Bridge, Autoupdate=True, Interval=66)
send = Send(Bridge=connect.Bridge, Actions=data, Send=send_program_to_bridge)  # -> Sent, Instructions
panel_3 = Panel(send.Sent)
panel_4 = Panel(send.Instructions)
actionexecuted = ActionExecuted(BridgeMessage=listen)  # -> LastAction, ActionTCP, ActionAxes, ActionExternalAxes, PendingActions, PendingActionsOnDevice
panel_5 = Panel(actionexecuted.LastAction)
data_recorder = DataRecorder(actionexecuted.ActionTCP, DataLimit=-10, RecordData=True)
panel_6 = Panel(actionexecuted.PendingActions)
plane = Plane(data_recorder)

# ---- group: Stream code to file: right-click on panel and stream contents to a text file in your system
panel_7 = Panel(compileprogram)
